# Grasshopper definition ARCH431_FA23_ERICSON_ANNOUS_MOHAMAD_FELIX3D.gh (Grasshopper 1.0.7)

dataset_01 = BooleanToggle(True)
get_file = GhPythonScript(update=dataset_01)  # -> file_path
# ---------- get_file: Python ----------
__author__ = "ANNOUS"
__version__ = "2023.02.01"



import rhinoscriptsyntax as rs


if update:
    file_name = rs.OpenFileName()
    print (file_name)
    file_path = file_name
    print(file_path)
else:
    file_path = None
# ---------- end get_file ----------
panel = Panel(get_file)
csv_to_points = GhPythonScript(file_path=panel)  # -> points
# ---------- csv_to_points: Python ----------
__author__ = "ericsonm"
__version__ = "2023.01.30"

import csv
import rhinoscriptsyntax as rs


#source: https://developer.rhino3d.com/guides/rhinopython/python-csv-file/
#source: https://www.geeksforgeeks.org/reading-csv-files-in-python/


with open(file_path, mode = 'r') as file:
    
    csv_file = csv.reader(file)
    points = []
    for line in csv_file:

        try:
            x = float(line[0])
            y = float(line[1])
            z = float(line[2])
            point = rs.AddPoint(x,y,z)
            points.append(point)
            
        except:
            pass
# ---------- end csv_to_points ----------

dataset_02 = BooleanToggle(True)
get_file_2 = GhPythonScript(update=dataset_02)  # -> file_path; same code as get_file
panel_2 = Panel(get_file_2)
csv_to_points_2 = GhPythonScript(file_path=panel_2)  # -> points; same code as csv_to_points

trigger = Trigger(Interval=20, TimerInterval=20, Target=cluster)  # disabled
relay = Relay()
relay_2 = Relay()

# ---- group: MANIPULATION_01
boolean_toggle = BooleanToggle(True)
shape = Slider(5, range=3..8)
radius = Slider(20, range=0..50)

# ----
relay_3 = Relay()
variation = Slider(3, range=0..5)

cluster = Cluster_2(relay=csv_to_points_2, reset=Toggle(False), list=csv_to_points_2)  # disabled

panel_3 = Panel(cluster)

data_recorder = DataRecorder(panel_3, DataLimit=-10, RecordData=True)

stream_filter = StreamFilter(Gate=Slider(0, range=0..1), Stream0=data_recorder, Stream1=csv_to_points_2)
csv = CSV(csv_points=csv_to_points, csv_points_2=stream_filter)  # -> relay_3, relay_4, relay_5, relay_6, relay, relay_2
manipulation_01 = MANIPULATION_01_2(
    segments=shape,
    relay=csv.relay_5,
    gate=boolean_toggle,
    radius=radius,
    relay_2=csv.relay_6,
    point=csv.relay_6,
    factor=csv.relay,
    factor_2=csv.relay_2)  # -> circle, moved
cap_holes = CapHoles(Brep=manipulation_01.moved)
brep = Brep(cap_holes)

# ---- group: SELECTION_02
variation_2 = Slider(3, range=0..5)
cluster_2 = Cluster(curve=manipulation_01.circle, count=variation_2, brep=brep)

# ----
seahorse_02 = Brep(cluster_2)

brep_2 = Brep(seahorse_02)
cap_holes_2 = CapHoles(Brep=brep_2)

deconstruct_brep = DeconstructBrep(Brep=cap_holes_2)  # -> Faces, Edges, flatten(Vertices)
point = Point(deconstruct_brep.Vertices)
point_2 = Point(point)
stream_filter_2 = StreamFilter(Gate=Slider(0, range=0..1), Stream0=point_2, Stream1=csv.relay_4)

# ---- group: MANIPULATION_01
# Segments: Determines Sides of a Polygon
# X : ‘X’ marks the spot for the CSV Points
# Gate: Clicking “True” Enables Polyginal Shapes,
# 						“False” Enables Circles
# Radius: Determines the Radius of the Shape
boolean_toggle_2 = BooleanToggle(True)
shape_2 = Slider(4, range=3..8)
radius_2 = Slider(12, range=0..50)
manipulation_01_2 = MANIPULATION_01(
    segments=shape_2,
    relay=csv.relay_3,
    gate=boolean_toggle_2,
    radius=radius_2,
    relay_2=stream_filter_2,
    point=stream_filter_2,
    factor=stream_filter_2,
    factor_2=stream_filter_2)  # -> circle, seahorse, brep_2, geometry, seahorse_2

# ---- group: SELECTION_01
fry_01 = Geometry(manipulation_01_2.seahorse)
fry_02 = Brep(manipulation_01_2.brep_2)
fry_03 = Brep(manipulation_01_2.geometry)
fry_04 = Brep(manipulation_01_2.seahorse_2)
gate = Slider(2, range=0..3)
manipulation_b = StreamFilter(Gate=gate, Stream0=fry_01, Stream1=fry_02, Stream2=fry_03, Stream3=fry_04)

# ----
seahorse_01 = Brep(manipulation_b)

# ---- group: SELECTION_02
cluster_3 = Cluster(curve=manipulation_01_2.circle, count=variation, brep=seahorse_01)

# ----
seahorse_02_2 = Brep(cluster_3)

seahorse = Brep([seahorse_02_2, seahorse_01])
cap_holes_3 = CapHoles(Brep=seahorse)

solid_difference = SolidDifference(BrepsA=cap_holes_2, BrepsB=cap_holes_3)  # disabled
brep_3 = Brep(solid_difference)

# ----
# Plan 01
panel_4 = Panel("10")  # disabled
xy_plane = XYPlane(Origin=Point(0, 0, 0))  # disabled
unit_z = UnitZ(Factor=panel_4)  # disabled
move = Move(Geometry=xy_plane, Motion=unit_z)  # -> Geometry, Transform; disabled
brep_plane = BrepPlane(Brep=brep_3, Plane=move.Geometry)  # -> Curves, Points; disabled
panel_5 = Panel("1")  # disabled
panel_6 = Panel("500")  # disabled
multiplication = Multiplication(A=panel_5, B=panel_6)  # disabled
unit_x = UnitX(Factor=multiplication)  # disabled
move_2 = Move(Geometry=brep_plane.Curves, Motion=unit_x)  # -> Geometry, Transform; disabled

# ----
# Plan 02
panel_7 = Panel("15")  # disabled
xy_plane_2 = XYPlane(Origin=Point(0, 0, 0))  # disabled
unit_z_2 = UnitZ(Factor=panel_7)  # disabled
move_3 = Move(Geometry=xy_plane_2, Motion=unit_z_2)  # -> Geometry, Transform; disabled
brep_plane_2 = BrepPlane(Brep=brep_3, Plane=move_3.Geometry)  # -> Curves, Points; disabled
panel_8 = Panel("2")  # disabled
panel_9 = Panel("500")  # disabled
multiplication_2 = Multiplication(A=panel_8, B=panel_9)  # disabled
unit_x_2 = UnitX(Factor=multiplication_2)  # disabled
move_4 = Move(Geometry=brep_plane_2.Curves, Motion=unit_x_2)  # -> Geometry, Transform; disabled

# ----
# Plan 03
panel_10 = Panel("50")  # disabled
xy_plane_3 = XYPlane(Origin=Point(0, 0, 0))  # disabled
unit_z_3 = UnitZ(Factor=panel_10)  # disabled
move_5 = Move(Geometry=xy_plane_3, Motion=unit_z_3)  # -> Geometry, Transform; disabled
brep_plane_3 = BrepPlane(Brep=brep_3, Plane=move_5.Geometry)  # -> Curves, Points; disabled
panel_11 = Panel("3")  # disabled
panel_12 = Panel("500")  # disabled
multiplication_3 = Multiplication(A=panel_11, B=panel_12)  # disabled
unit_x_3 = UnitX(Factor=multiplication_3)  # disabled
move_6 = Move(Geometry=brep_plane_3.Curves, Motion=unit_x_3)  # -> Geometry, Transform; disabled

# ----
# Section
panel_13 = Panel("0")  # disabled
xz_plane = XZPlane(Origin=Point(0, 0, 0))  # disabled
unit_y = UnitY(Factor=panel_13)  # disabled
move_7 = Move(Geometry=xz_plane, Motion=unit_y)  # -> Geometry, Transform; disabled
brep_plane_4 = BrepPlane(Brep=brep_3, Plane=move_7.Geometry)  # -> Curves, Points; disabled
panel_14 = Panel("4")  # disabled
panel_15 = Panel("500")  # disabled
unit_x_4 = UnitX(Factor=1)  # disabled
multiplication_4 = Multiplication(A=panel_14, B=panel_15)  # disabled
unit_x_5 = UnitX(Factor=multiplication_4)  # disabled
panel_16 = Panel("-90")  # disabled
rotate_3d = Rotate3D(Geometry=brep_plane_4.Curves, Angle=degrees(panel_16), Center=Point(0, 0, 0), Axis=unit_x_4)  # -> Geometry, Transform; disabled
move_8 = Move(Geometry=rotate_3d.Geometry, Motion=unit_x_5)  # -> Geometry, Transform; disabled

geometry = Geometry([move_2.Geometry, move_6.Geometry, move_4.Geometry])  # disabled
plan_center_2 = Point(unit_x_2)  # disabled
plan_center_3 = Point(unit_x_3)  # disabled
section_01 = Geometry(move_8.Geometry)  # disabled
section_center_1 = Point(unit_x_5)  # disabled
plan_center_1 = Point(unit_x)  # disabled

# ---- group: Hatch Group
boundary_surfaces = BoundarySurfaces(Edges=[geometry, section_01])  # disabled
panel_17 = Panel("45")  # disabled
vector_at_angle = PythonScript(angle=panel_17)  # -> vector; disabled
# ---------- vector_at_angle: Python ----------
import rhinoscriptsyntax as rs
import math
if angle == None:
    Vector = None
else:
    c=rs.AddPoint(0,0,0)
    f=math.radians(float(angle))
    l=rs.AddPoint(math.cos(f),math.sin(f),0)
    d=rs.VectorCreate(l,c)
    vector =rs.VectorUnitize(d)
# ---------- end vector_at_angle ----------
panel_18 = Panel(".5")  # disabled

# ----
panel_19 = Panel("20")  # disabled
panel_20 = Panel("8")  # disabled
panel_21 = Panel("11.7")  # disabled
multiplication_5 = Multiplication(A=panel_21, B=panel_19)  # disabled
multiplication_6 = Multiplication(A=panel_20, B=panel_19)  # disabled
centered_rectangle = GhPythonScript(width=multiplication_6, height=multiplication_5, point=[plan_center_1, section_center_1, plan_center_2, plan_center_3])  # -> rectangle, center; disabled
# ---------- centered_rectangle: Python ----------
__author__ = "ericsonm"
__version__ = "2019.01.15"

import rhinoscriptsyntax as rs
import Rhino as rh

if (width or height) == None:
    rectangle = None

else:
    point1 = rs.coerce3dpoint(point)
    centerX = rh.Geometry.Point3d.X.GetValue(point1)
    centerY = rh.Geometry.Point3d.Y.GetValue(point1)
    centerZ = rh.Geometry.Point3d.Z.GetValue(point1)
    x1 = float(width)
    y1 = float(height)
    xc = x1/-2 + float(centerX)
    yc = y1/-2 + float(centerY)
    center = rs.AddPoint(float(centerX),float(centerY),float(centerZ))

    rectangle = rs.AddRectangle((xc,yc,0),x1,y1)
# ---------- end centered_rectangle ----------

contour = Contour(Shape=boundary_surfaces, Point=Point(0, 0, 0), Direction=vector_at_angle, Distance=panel_18)  # -> flatten(Contours); disabled
geometry_2 = Geometry(contour)  # disabled
geometry_3 = Geometry(geometry_2)  # disabled
sheet = Geometry(centered_rectangle.rectangle)  # disabled

# ==== cluster MANIPULATION_01
segments = ClusterInput()
gate = ClusterInput()

relay = ClusterInput()
radius = ClusterInput()
relay_2 = ClusterInput()
factor = ClusterInput()
factor_2 = ClusterInput()
create_circles = GhPythonScript(x=relay, radius=radius)  # -> out, circle
# ---------- create_circles: Python ----------
"""Provides a scripting component.
    Inputs:
        x: The x script variable
        y: The y script variable
    Output:
        circle: The a output variable"""

__author__ = "mohamadannous"

import rhinoscriptsyntax as rs

circle = rs.AddCircle(x,radius)
# ---------- end create_circles ----------
unit_x = UnitX(Factor=factor_2)
unit_y = UnitY(Factor=factor)
circle = ClusterOutput(create_circles.circle)
point = ClusterInput()
point_2 = Point(point)

# ---- group: PRIMARY MANIPULATION
deconstruct = Deconstruct(Point=relay_2)  # -> XComponent, YComponent, ZComponent

# ----
polygon = Polygon(Plane=relay, Radius=radius, Segments=segments, FilletRadius=0)  # -> Polygon, Length

unit_z = UnitZ(Factor=deconstruct.XComponent)
stream_filter = StreamFilter(Gate=gate, Stream0=create_circles.circle, Stream1=polygon.Polygon)
extrude_circles = Extrude(Base=stream_filter, Direction=unit_z)
brep = Brep(extrude_circles)

# ---- group: PRIMARY MANIPULATION / SHEAR
radians_value = Deconstruct(Point=point_2)  # -> XComponent, YComponent, ZComponent
shear = GhPythonScript(object=extrude_circles, value=radians_value.XComponent)  # -> out, flatten(seahorse)
# ---------- shear: Python ----------
"""Provides a scripting component.
    Inputs:
        x: The x script variable
        y: The y script variable
    Output:
        seahorse: The a output variable"""

__author__ = "mohamadannous"

import rhinoscriptsyntax as rs
import math

origin = (0,0,0)

objs = (object)
if objs:
    if origin:
        plane = rs.ViewCPlane()
        plane = rs.MovePlane(plane,origin)
    
    cplane = rs.ViewCPlane("Top",plane)
    cob = rs.XformChangeBasis(rs.WorldXYPlane(), cplane)
    shear2d = rs.XformIdentity()
    shear2d[0,2] = math.tan(math.radians(value))
    cob_inv = rs.XformChangeBasis(cplane, rs.WorldXYPlane())
    temp_01 = rs.XformMultiply(shear2d, cob)
    xform = rs.XformMultiply(cob_inv, temp_01)
    seahorse = rs.TransformObjects(objs, xform, True)
# ---------- end shear ----------

# ----
mirror = Mirror(Geometry=brep, Plane="0,20,45")  # -> Geometry, Transform
shear_2 = GhPythonScript(object=mirror.Geometry, value=simplify([radians_value.XComponent, radians_value.YComponent]))  # -> out, flatten(seahorse)
# ---------- shear_2: Python ----------
"""Provides a scripting component.
    Inputs:
        x: The x script variable
        y: The y script variable
    Output:
        seahorse: The a output variable"""

__author__ = "mohamadannous"

import rhinoscriptsyntax as rs
import math

origin = (0,0,0)

objs = (object)
if objs:
    if origin:
        plane = rs.ViewCPlane()
        plane = rs.MovePlane(plane,origin)
    
    cplane = rs.ViewCPlane("Top",plane)
    cob = rs.XformChangeBasis(rs.WorldXYPlane(), cplane)
    shear2d = rs.XformIdentity()
    shear2d[0,2] = math.tan(math.radians(value/2))
    cob_inv = rs.XformChangeBasis(cplane, rs.WorldXYPlane())
    temp_01 = rs.XformMultiply(shear2d, cob)
    xform = rs.XformMultiply(cob_inv, temp_01)
    seahorse = rs.TransformObjects(objs, xform, True)
# ---------- end shear_2 ----------
geometry = ClusterOutput(mirror.Geometry)
seahorse = ClusterOutput(shear.seahorse)
brep_2 = ClusterOutput(brep)
seahorse_2 = ClusterOutput(shear_2.seahorse)

# ==== cluster Cluster
curve = ClusterInput()
count = ClusterInput()
brep = ClusterInput()

curve_2 = Curve(curve)
brep_2 = Brep(brep)
divide_curve = DivideCurve(Curve=curve_2, Count=count, Kinks=False)  # -> flatten(Points), Tangents, Parameters
area = Area(Geometry=brep_2)  # -> Area, Centroid
vector_2pt = Vector2Pt(PointA=area.Centroid, PointB=divide_curve.Points, Unitize=False)  # -> Vector, Length
move = Move(Geometry=brep_2, Motion=vector_2pt.Vector)  # -> Geometry, Transform

geometry = ClusterOutput(move.Geometry)

# ==== cluster MANIPULATION_01_2
segments = ClusterInput()
gate = ClusterInput()

relay = ClusterInput()
radius = ClusterInput()
relay_2 = ClusterInput()
factor = ClusterInput()
factor_2 = ClusterInput()
create_circles = GhPythonScript(x=relay_2, radius=radius)  # -> out, circle; same code as create_circles
unit_x = UnitX(Factor=factor_2)
unit_y = UnitY(Factor=factor)
circle = ClusterOutput(create_circles.circle)
point = ClusterInput()
point_2 = Point(point)

# ---- group: PRIMARY MANIPULATION
deconstruct = Deconstruct(Point=relay_2)  # -> XComponent, YComponent, ZComponent

# ----
polygon = Polygon(Plane=relay, Radius=radius, Segments=segments, FilletRadius=0)  # -> Polygon, Length

unit_z = UnitZ(Factor=deconstruct.XComponent)
stream_filter = StreamFilter(Gate=gate, Stream0=create_circles.circle, Stream1=polygon.Polygon)
extrude_circles = Extrude(Base=stream_filter, Direction=unit_z)
brep = Brep(extrude_circles)

# ---- group: PRIMARY MANIPULATION / SHEAR
radians_value = Deconstruct(Point=point_2)  # -> XComponent, YComponent, ZComponent
shear = GhPythonScript(object=extrude_circles, value=radians_value.XComponent)  # -> out, flatten(seahorse); same code as shear

# ----
mirror = Mirror(Geometry=brep, Plane="0,20,45")  # -> Geometry, Transform
shear_2 = GhPythonScript(object=mirror.Geometry, value=graft([radians_value.XComponent, radians_value.YComponent]))  # -> out, flatten(seahorse); same code as shear_2
move_to_point = MoveToPoint(Geometry=mirror.Geometry, PointA="0,20,45", PointB="-20,-20,50")  # -> Moved, Vector, Transform
moved = ClusterOutput(move_to_point.Moved)

# ==== cluster Cluster_2
list = ClusterInput()
list_length = ListLength(List=list)
relay = ClusterInput()
reset = ClusterInput()
linear_loop = PythonScript(reset=reset, Interval="1", Inc="1", Max=list_length, Min="0", Iterations="500")  # -> Val, Iteration
# ---------- linear_loop: Python ----------
#this timer loop stops when either the number of iterations are reached or the boolean condition is set true.
#The update also stops preventing the last element in the list from being duplicated indefinitely.
import time
import Grasshopper as gh


def updateComponent():
    
    """ Updates this component, similar to using a grasshopper timer """
    
    # Define callback action
    def callBack(e):
        ghenv.Component.ExpireSolution(False)
        
    # Get grasshopper document
    ghDoc = ghenv.Component.OnPingDocument()
    
    # Schedule this component to expire
    ghDoc.ScheduleSolution(int(Interval),gh.Kernel.GH_Document.GH_ScheduleDelegate(callBack))

#sets the starting point of the counter
count = 0
its = 0

if reset:
    counter = float(Min)
    it = 0
#adds the increment to counter
else:
    counter += float(Inc)
    it += float(Inc)
    
#reverses the count in the negative direction
if counter > float(Max):
    counter = -float(Max)
    
#reverses the count in the positive direction
if abs (counter) <  float(Min):
    counter = float(Min)
    
#provides an output
Val = abs(counter)

Iteration = it
print it
#stops and start the update
if it< float(Iterations) and not reset:
    updateComponent()
# ---------- end linear_loop ----------
panel = Panel(linear_loop.Val)
list_item = ListItem(List=relay, Index=panel, Wrap=True)
panel_2 = Panel(list_item)
i = ClusterOutput(list_item)

# ==== cluster CSV
csv_points = ClusterInput()
csv_points_2 = ClusterInput()
csv_points_3 = Relay()

music_waveform = Deconstruct(Point=csv_points)  # -> XComponent, YComponent, ZComponent
panel = Panel(music_waveform.XComponent)
panel_2 = Panel(music_waveform.YComponent)
panel_3 = Panel(music_waveform.ZComponent)

music_waveform_2 = Deconstruct(Point=csv_points_2)  # -> XComponent, YComponent, ZComponent
panel_4 = Panel(music_waveform_2.XComponent)
panel_5 = Panel(music_waveform_2.YComponent)
panel_6 = Panel(music_waveform_2.ZComponent)

relay = ClusterOutput(panel_5)
relay_2 = ClusterOutput(panel_6)
relay_3 = ClusterOutput(csv_points)
relay_4 = ClusterOutput(csv_points)
relay_5 = ClusterOutput(csv_points_2)
relay_6 = ClusterOutput(csv_points_2)
